# Grasshopper definition SwimmerBot.gh (Grasshopper 1.0.7)

highfrictionpadthickness = Slider(1, range=0.2..1)
segment_offset = Slider(2, range=0..4)
is_show_middle_hooks = BooleanToggle(True)
guidecapheight = Slider(0.7, range=0.5..1)
is_horizontal_tendon = BooleanToggle(True)
guidecapwidth = Slider(0.31, range=0.31..1)
hookbarbspacing = Slider(0.5, range=0..1)
hooklegdiameter = Slider(1.5, range=0..10)
frontratio = Slider(0.8, range=0..1)
guideextrusion = Slider(2, range=2..4)
guideheight = Slider(3, range=1..10)
backratio = Slider(0.8, range=0..1)
tendondiameter = Slider(0.7, range=0.2..1.2)
guideslitgap = Slider(0, range=0..4)
taillength = Slider(18, range=10..20)
hooktipangle = Slider(45, range=0..100)
tailoffset = Slider(0.5, range=0..10)
hooklength = Slider(5.5, range=3..12)
midguidegap = Slider(4, range=0..6)
thickness = Slider(3, range=0..5)
hookleglength = Slider(1.5, range=1..3)
headoffset = Slider(1.5, range=0..10)
guidewidth = Slider(1.5, range=1..3)
rigidmaterialcolor = ColourSwatch(SwatchColor=RGB(255, 255, 255))
flexiblematerialcolor = ColourSwatch(SwatchColor=RGB(33, 30, 30))
length = Slider(64, range=0..100)
height = Slider(10, range=0..20)
rigidmaterial_col = Colour(rigidmaterialcolor)
ishorizontaltendon_bool = Boolean(is_horizontal_tendon)
isshowmidhooks_bool = Boolean(is_show_middle_hooks)
flexiblematerial_col = Colour(flexiblematerialcolor)
frontratio_num = Number(frontratio)
thickness_num = Number(thickness)
length_num = Number(length)
taillength_num = Number(taillength)
headoffset_num = Number(headoffset)
tailoffset_num = Number(tailoffset)
height_num = Number(height)
backratio_num = Number(backratio)
guidewidth_num = Number(guidewidth)
segmentoffset_num = Number(segment_offset)
guideslitgap_num = Number(guideslitgap)
hooktipangle_num = Number(hooktipangle)
guideheight_num = Number(guideheight)
midguidegap_num = Number(midguidegap)
guidecapwidth_num = Number(guidecapwidth)
guidecapheight_num = Number(guidecapheight)
guideextrusion_num = Number(guideextrusion)
hookleglength_num = Number(hookleglength)
hookbarbspacing_num = Number(hookbarbspacing)
hooklegdiameter_num = Number(hooklegdiameter)
hooklength_num = Number(hooklength)
tendondiameter_num = Number(tendondiameter)
highfrictionpadthickness_num = Number(highfrictionpadthickness)
rigidmaterial_col_2 = Colour(rigidmaterial_col)
length_num_2 = Number(length_num)
height_num_2 = Number(height_num)
flexiblematerial_col_2 = Colour(flexiblematerial_col)
thickness_num_2 = Number(thickness_num)
tailoffset_num_2 = Number(tailoffset_num)
frontratio_num_2 = Number(frontratio_num)
taillength_num_2 = Number(taillength_num)
backratio_num_2 = Number(backratio_num)
ishorizontaltendon_bool_2 = Boolean(ishorizontaltendon_bool)
headoffset_num_2 = Number(headoffset_num)
isshowmidhooks_bool_2 = Boolean(isshowmidhooks_bool)
guideslitgap_num_2 = Number(guideslitgap_num)
guidewidth_num_2 = Number(guidewidth_num)
hooktipangle_num_2 = Number(hooktipangle_num)
midguidegap_num_2 = Number(midguidegap_num)
guideheight_num_2 = Number(guideheight_num)
segmentoffset_num_2 = Number(segmentoffset_num)
guidecapwidth_num_2 = Number(guidecapwidth_num)
guideextrusion_num_2 = Number(guideextrusion_num)
tendondiameter_num_2 = Number(tendondiameter_num)
guidecapheight_num_2 = Number(guidecapheight_num)
hookleglength_num_2 = Number(hookleglength_num)
hooklength_num_2 = Number(hooklength_num)
hooklegdiameter_num_2 = Number(hooklegdiameter_num)
hookbarbspacing_num_2 = Number(hookbarbspacing_num)
highfrictionpadthickness_num_2 = Number(highfrictionpadthickness_num)

# ---- group: BodyZAxisPlane
thickness_num_3 = Number(thickness_num)
bodyvertialmidpt = ConstructPoint(XCoordinate=0, YCoordinate=expr("x/2", thickness_num_3), ZCoordinate=0)
bodyzaxisplane = ConstructPlane(Origin=bodyvertialmidpt, XAxis=Vector(1, 0, 0), YAxis=Vector(0, 0, 1))
bodyzaxisplane_pln = Plane(bodyzaxisplane)

# ----
rigidmaterial_col_3 = Colour(rigidmaterial_col)

# ---- group: GuideHoleFirstCorner
headoffset_num_3 = Number(headoffset_num)
tailoffset_num_3 = Number(tailoffset_num)
length_num_3 = Number(length_num)
activebodylength = Evaluate(F="bodyLength-headOffset-tailOffset", headOffset=headoffset_num_3, tailOffset=tailoffset_num_3, bodyLength=length_num_3)

# ----
flexiblematerial_col_3 = Colour(flexiblematerial_col)
flexiblematerial_col_4 = Colour(flexiblematerial_col)
rigidmaterial_col_4 = Colour(rigidmaterial_col)
rigidmaterial_col_5 = Colour(rigidmaterial_col)
flexiblematerial_col_5 = Colour(flexiblematerial_col)

# ---- group: GuideHoleFirstCorner
guidewidth_num_3 = Number(guidewidth_num)
frontratio_num_3 = Number(frontratio_num)
backratio_num_3 = Number(backratio_num)
tailoffset_num_4 = Number(tailoffset_num)
length_num_4 = Number(length_num)
guideheight_num_3 = Number(guideheight_num)
guidewidth_num_4 = Number(guidewidth_num)
tailoffset_num_5 = Number(tailoffset_num)
height_num_3 = Number(height_num)
length_num_5 = Number(length_num)
getguidepos3 = Evaluate(
    F="bodyLength - tailOffset - activeBodyLength*backRatio",
    activeBodyLength=activebodylength,
    bodyLength=length_num_4,
    tailOffset=tailoffset_num_4,
    backRatio=backratio_num_3)
guidez = Evaluate(F="(bodyHeight - guideHeight)/2", bodyHeight=height_num_3, guideHeight=guideheight_num_3)
activebodylength_2 = Evaluate(F="bodyLength-tailOffset-guideWidth", tailOffset=tailoffset_num_5, bodyLength=length_num_5, guideWidth=guidewidth_num_4)
headoffset_num_4 = Number(headoffset_num)
getguidepos2 = Evaluate(
    F="headOffset+ activeBodyLength*frontRatio - guideWidth",
    activeBodyLength=activebodylength,
    headOffset=headoffset_num_4,
    guideWidth=guidewidth_num_3,
    frontRatio=frontratio_num_3)
guideholexfirstcorner = Panel([headoffset_num_4, getguidepos2, getguidepos3, activebodylength_2])
guideholefirstcorner = ConstructPoint(XCoordinate=guideholexfirstcorner, YCoordinate=0, ZCoordinate=guidez)

# ---- group: Head
thickness_num_4 = Number(thickness_num)
thickness_num_5 = Number(thickness_num)
thickness_num_6 = Number(thickness_num)
thickness_num_7 = Number(thickness_num)
pt = ConstructPoint(XCoordinate=expr("-x/2-1", thickness_num_4), YCoordinate=expr("x/2", thickness_num_5), ZCoordinate=0)
pt_2 = ConstructPoint(XCoordinate=-1, YCoordinate=0, ZCoordinate=0)
pt_3 = ConstructPoint(XCoordinate=0, YCoordinate=0, ZCoordinate=0)
pt_4 = ConstructPoint(XCoordinate=0, YCoordinate=thickness_num_6, ZCoordinate=0)
pt_5 = ConstructPoint(XCoordinate=-1, YCoordinate=thickness_num_7, ZCoordinate=0)
pline = PolyLine(Vertices=[pt_2, pt_3, pt_4, pt_5], Closed=False)
arc = Arc3Pt(PointA=Point(-1, 0, 0), PointB=pt, PointC=pt_5)  # -> Arc, Plane, Radius
height_num_4 = Number(height_num)
join = JoinCurves(Curves=[pline, arc.Arc], Preserve=False)
Z = UnitZ(Factor=height_num_4)
extr = Extrude(Base=join, Direction=Z)
cap = CapHoles(Brep=extr)

# ---- group: Hooks / List of guide X
cornerpoint2 = ListItem(List=guideholexfirstcorner, Index=1, Wrap=True)
cornerpoint4 = ListItem(List=guideholexfirstcorner, Index=3, Wrap=True)
cornerpoint1 = ListItem(List=guideholexfirstcorner, Index=0, Wrap=True)
cornerpoint3 = ListItem(List=guideholexfirstcorner, Index=2, Wrap=True)

# ---- group: Hooks / HooksBasePoints
eval = Evaluate(F="(x+y)/2", x=cornerpoint3, y=cornerpoint4)
eval_2 = Evaluate(F="(x+y)/2", x=cornerpoint1, y=cornerpoint2)
hooklegdiameter_num_3 = Number(hooklegdiameter_num)
hookleglength_num_3 = Number(hookleglength_num)
height_num_5 = Number(height_num)
eval_3 = Evaluate(F="x + hookLegDiameter/2", x=[guideholexfirstcorner, eval_2, eval], hookLegDiameter=hooklegdiameter_num_3)
thickness_num_8 = Number(thickness_num)
subtraction = Subtraction(A=height_num_5, B=hookleglength_num_3)
pt_6 = ConstructPoint(XCoordinate=eval_3, YCoordinate=expr("x/2", thickness_num_8), ZCoordinate=subtraction)

# ---- group: GuideHoleFirstCornersWithOffset / GuideHoleCornerPoint3
cornerpoint3_2 = ListItem(List=guideholefirstcorner, Index=2, Wrap=True)
pdecon = Deconstruct(Point=cornerpoint3_2)  # -> XComponent, YComponent, ZComponent
segmentoffset_num_3 = Number(segmentoffset_num)
eval_4 = Evaluate(F="x + y/2", x=pdecon.ZComponent, y=segmentoffset_num_3)
pt_7 = ConstructPoint(XCoordinate=pdecon.XComponent, YCoordinate=pdecon.YComponent, ZCoordinate=eval_4)

# ---- group: GuideHoleFirstCornersWithOffset / GuideHoleCornerPoint4
cornerpoint1_2 = ListItem(List=guideholefirstcorner, Index=3, Wrap=True)
ishorizontaltendon_bool_3 = Boolean(ishorizontaltendon_bool)
pdecon_2 = Deconstruct(Point=cornerpoint1_2)  # -> XComponent, YComponent, ZComponent
expression = Expression(x=ishorizontaltendon_bool_3, y=eval_4, z=pdecon_2.ZComponent, Expression="If(x = True, y, z)")
pt_8 = ConstructPoint(XCoordinate=pdecon_2.XComponent, YCoordinate=pdecon_2.YComponent, ZCoordinate=expression)

# ---- group: GuideHoleFirstCornersWithOffset / GuideHoleCornerPoint2
cornerpoint2_2 = ListItem(List=guideholefirstcorner, Index=1, Wrap=True)
pdecon_3 = Deconstruct(Point=cornerpoint2_2)  # -> XComponent, YComponent, ZComponent
segmentoffset_num_4 = Number(segmentoffset_num)
eval_5 = Evaluate(F="x - y/2", x=pdecon_3.ZComponent, y=segmentoffset_num_4)
pt_9 = ConstructPoint(XCoordinate=pdecon_3.XComponent, YCoordinate=pdecon_3.YComponent, ZCoordinate=eval_5)

# ---- group: GuideHoleFirstCornersWithOffset / GuideHoleCornerPoint1
cornerpoint1_3 = ListItem(List=guideholefirstcorner, Index=0, Wrap=True)
ishorizontaltendon_bool_4 = Boolean(ishorizontaltendon_bool)
pdecon_4 = Deconstruct(Point=cornerpoint1_3)  # -> XComponent, YComponent, ZComponent
expression_2 = Expression(x=ishorizontaltendon_bool_4, y=eval_5, z=pdecon_4.ZComponent, Expression="If(x = True, y, z)")
pt_10 = ConstructPoint(XCoordinate=pdecon_4.XComponent, YCoordinate=pdecon_4.YComponent, ZCoordinate=expression_2)

# ---- group: Hooks / HooksBody
hooklegdiameter_num_4 = Number(hooklegdiameter_num)
thickness_num_9 = Number(thickness_num)
eval_6 = Evaluate(F="(bodyThickness - hookLegDiameter)/2", bodyThickness=thickness_num_9, hookLegDiameter=hooklegdiameter_num_4)

# ---- group: GuideHoleFirstCornersWithOffset
guideholefirstcornerpointswithoffset = Panel([pt_10, pt_9, pt_7, pt_8])

# ---- group: GuideHoles / GuideCirCenter
tendondiameter_num_3 = Number(tendondiameter_num)
guideheight_num_4 = Number(guideheight_num)
vec = VectorXYZ(XComponent=0, YComponent=expr("-x/2", tendondiameter_num_3), ZComponent=expr("x/2", guideheight_num_4))  # -> Vector, Length
move = Move(Geometry=guideholefirstcornerpointswithoffset, Motion=vec.Vector)  # -> Geometry, Transform

# ---- group: Hooks / HooksBody
hooktipangle_num_3 = Number(hooktipangle_num)
thickness_num_10 = Number(thickness_num)
eval_7 = Evaluate(F="(bodyThickness/2)/tan(2*π*hookTipAngle/360)", hookTipAngle=hooktipangle_num_3, bodyThickness=thickness_num_10)
Z_2 = UnitZ(Factor=expr("-x", eval_7))

hooktipangle_num_4 = Number(hooktipangle_num)
eval_8 = Evaluate(F="(bardExtrusion)/tan(2*π*hookTipAngle/360)", bardExtrusion=eval_6, hookTipAngle=hooktipangle_num_4)
Z_3 = UnitZ(Factor=expr("-x", eval_8))

# ---- group: GuideHoles
Y = UnitY(Factor=1)
Z_4 = UnitZ(Factor=1)
guidecircleplane = ConstructPlane(Origin=move.Geometry, XAxis=Y, YAxis=Z_4)

# ---- group: Hooks / HooksBody
hooklength_num_3 = Number(hooklength_num)
Z_5 = UnitZ(Factor=hooklength_num_3)

hookbarbspacing_num_3 = Number(hookbarbspacing_num)
Z_6 = UnitZ(Factor=expr("-x", hookbarbspacing_num_3))

hooklegdiameter_num_5 = Number(hooklegdiameter_num)
Y_2 = UnitY(Factor=expr("x/2", hooklegdiameter_num_5))

# ---- group: MainBody
thickness_num_11 = Number(thickness_num)
length_num_6 = Number(length_num)
height_num_6 = Number(height_num)
baserect = Rectangle(Plane=PlaneXY(0, 0, 0), XSize=length_num_6, YSize=thickness_num_11, Radius=0)  # -> Rectangle, Length
mainbody = BoxRectangle(Rectangle=baserect.Rectangle, Height=height_num_6)

# ----
thickness_num_12 = Number(thickness_num)

# ---- group: GuideHoles
tendondiameter_num_4 = Number(tendondiameter_num)
guidecir = Circle(Plane=guidecircleplane, Radius=expr("x/2", tendondiameter_num_4))

tendondiameter_num_5 = Number(tendondiameter_num)
Y_3 = UnitY(Factor=1)
line = LineSDL(Start=move.Geometry, Direction=Y_3, Length=tendondiameter_num_5)

# ----
bodyzaxisplane_pln_2 = Plane(bodyzaxisplane)

# ---- group: Tail
taillength_num_3 = Number(taillength_num)
length_num_7 = Number(length_num)
gettailtipx = Evaluate(F="bodyLength+tailLength", bodyLength=length_num_7, tailLength=taillength_num_3)
thickness_num_13 = Number(thickness_num)
thickness_num_14 = Number(thickness_num)
length_num_8 = Number(length_num)
length_num_9 = Number(length_num)
pt_11 = ConstructPoint(XCoordinate=gettailtipx, YCoordinate=expr("x/2", thickness_num_13), ZCoordinate=0)
pt_12 = ConstructPoint(XCoordinate=length_num_9, YCoordinate=0, ZCoordinate=0)
pt_13 = ConstructPoint(XCoordinate=length_num_8, YCoordinate=thickness_num_14, ZCoordinate=0)
height_num_7 = Number(height_num)
pline_2 = PolyLine(Vertices=[pt_12, pt_13, pt_11], Closed=True)
Z_7 = UnitZ(Factor=height_num_7)
extr_2 = Extrude(Base=pline_2, Direction=Z_7)
cap_2 = CapHoles(Brep=extr_2)

# ----
guideslitgap_num_3 = Number(guideslitgap_num)
smaller = SmallerThan(FirstNumber=guideslitgap_num_3, SecondNumber=0.002)  # -> SmallerThan, OrEqualTo

guideslitgap_num_4 = Number(guideslitgap_num)

previewheadtip = CustomPreview(Geometry=cap, Material=rigidmaterial_col_3)

previewtail = CustomPreview(Geometry=cap_2, Material=flexiblematerial_col_5)

# ---- group: Hooks / HooksBody
flip = FlipMatrix(Data=pt_6)
move_2 = Move(Geometry=flip, Motion=Y_2)  # -> Geometry, Transform
move_3 = Move(Geometry=flip, Motion=Z_5)  # -> Geometry, Transform
pline_3 = PolyLine(Vertices=[move_3.Geometry, flip], Closed=False)

thickness_num_15 = Number(thickness_num)
Y_4 = UnitY(HalfBodyThickness=expr("x/2", thickness_num_15))
move_4 = Move(Geometry=move_3.Geometry, Motion=Y_4)  # -> Geometry, Transform

# ---- group: HookHoles
thickness_num_16 = Number(thickness_num)
height_num_8 = Number(height_num)
hookleglength_num_4 = Number(hookleglength_num)
flatten = FlattenTree(Tree=flip, Path="{0}")
bodyvertialmidpt_2 = ConstructPoint(XCoordinate=0, YCoordinate=expr("x/2", thickness_num_16), ZCoordinate=expr("x/2", height_num_8))
circle = CircleCNR(Center=flatten, Normal=Vector(0, 0, 1), Radius=0.75)
Z_8 = UnitZ(Factor=hookleglength_num_4)
extr_3 = Extrude(Base=circle, Direction=Z_8)
bodyxaxisplane = ConstructPlane(Origin=bodyvertialmidpt_2, XAxis=Vector(1, 0, 0), YAxis=Vector(0, 1, 0))
mirror = Mirror(Geometry=extr_3, Plane=bodyxaxisplane)  # -> Geometry, Transform
cap_3 = CapHoles(Brep=[extr_3, mirror.Geometry])

# ---- group: MainBody
pdecon_5 = Deconstruct(Point=guideholefirstcornerpointswithoffset)  # -> XComponent, YComponent, ZComponent
guideheight_num_5 = Number(guideheight_num)
guidewidth_num_5 = Number(guidewidth_num)
secondcornerz = Evaluate(F="z + guideHeight", z=pdecon_5.ZComponent, guideHeight=guideheight_num_5)
secondcornerx = Evaluate(F="x + guideWidth", x=pdecon_5.XComponent, guideWidth=guidewidth_num_5)
guideholesecondcorner = ConstructPoint(XCoordinate=secondcornerx, YCoordinate=pdecon_5.YComponent, ZCoordinate=secondcornerz)
rec_2pt = Rectangle2Pt(
    Plane=Plane(origin=(0, 0, 0), x=(0, 0, 1), y=(1, 0, 0)),
    PointA=guideholefirstcornerpointswithoffset,
    PointB=guideholesecondcorner,
    Radius=0)  # -> Rectangle, Length
join_2 = JoinCurves(Curves=rec_2pt.Rectangle, Preserve=False)
Y_5 = UnitY(Factor=thickness_num_12)
extr_4 = Extrude(Base=join_2, Direction=Y_5)
cap_4 = CapHoles(Brep=extr_4)
sdiff = SolidDifference(BrepsA=mainbody, BrepsB=cap_4)
sdiff_2 = SolidDifference(BrepsA=sdiff, BrepsB=cap_3)

# ----
previewmainbody = CustomPreview(Geometry=sdiff_2, Material=flexiblematerial_col_4)

# ---- group: Guides
guideextrusion_num_3 = Number(guideextrusion_num)
guideslitgap_num_5 = Number(guideslitgap_num)
getguidearm = Evaluate(F="guideExtrusion - guideSlitGap", guideExtrusion=guideextrusion_num_3, guideSlitGap=guideslitgap_num_5)
guideextrusion_num_4 = Number(guideextrusion_num)
guideheight_num_6 = Number(guideheight_num)
guideextrusion_num_5 = Number(guideextrusion_num)
guideheight_num_7 = Number(guideheight_num)
thickness_num_17 = Number(thickness_num)
Y_6 = UnitY(Factor=expr("-x", guideextrusion_num_4))
Y_7 = UnitY(Factor=expr("x/2", thickness_num_17))
Z_9 = UnitZ(Factor=expr("-x", guideheight_num_6))
Z_10 = UnitZ(Factor=guideheight_num_7)
Y_8 = UnitY(Factor=getguidearm)
Y_9 = UnitY(Factor=guideextrusion_num_5)
move_5 = Move(Geometry=guideholefirstcornerpointswithoffset, Motion=Y_6)  # -> Geometry, Transform
move_6 = Move(Geometry=move_5.Geometry, Motion=Z_10)  # -> Geometry, Transform
move_7 = Move(Geometry=move_6.Geometry, Motion=Y_8)  # -> Geometry, Transform
move_8 = Move(Geometry=move_6.Geometry, Motion=Y_9)  # -> Geometry, Transform
move_9 = Move(Geometry=move_8.Geometry, Motion=Y_7)  # -> Geometry, Transform
move_10 = Move(Geometry=move_9.Geometry, Motion=Z_9)  # -> Geometry, Transform
flip_2 = FlipMatrix(Data=move_9.Geometry)
flip_3 = FlipMatrix(Data=move_10.Geometry)
flip_4 = FlipMatrix(Data=move_5.Geometry)
flip_5 = FlipMatrix(Data=move_6.Geometry)
flip_6 = FlipMatrix(Data=move_7.Geometry)
flip_7 = FlipMatrix(Data=move_8.Geometry)
guidewidth_num_6 = Number(guidewidth_num)
bodyzaxisplane_pln_3 = Plane(bodyzaxisplane)
X = UnitX(Factor=guidewidth_num_6)

# ---- group: GuideHoles
guideheight_num_8 = Number(guideheight_num)
Z_11 = UnitZ(Factor=1)
line_2 = LineSDL(Start=move_7.Geometry, Direction=expr("-x", Z_11), Length=guideheight_num_8)

ccx = CurveCurve(CurveA=line_2, CurveB=guidecir)  # -> Points, ParamsA, ParamsB
ccx_2 = CurveCurve(CurveA=line, CurveB=guidecir)  # -> Points, ParamsA, ParamsB
item = ListItem(List=ccx.Points, Index=1, Wrap=True)
item_2 = ListItem(List=ccx_2.Points, Index=0, Wrap=True)
item_3 = ListItem(List=ccx.Points, Index=0, Wrap=True)
arc_2 = Arc3Pt(PointA=item_2, PointB=item, PointC=item_3)  # -> Arc, Plane, Radius
flatten_2 = FlattenTree(Tree=item_3, Path="{0}")
flatten_3 = FlattenTree(Tree=item_2, Path="{0}")
flip_8 = FlipMatrix(Data=flatten_2)
flip_9 = FlipMatrix(Data=flatten_3)

# ----
expression_3 = Expression(x=guideslitgap_num_4, y=guidecir, z=arc_2.Arc, Expression="If(x ≤ 0.002, y, z)")

# ---- group: Hooks / HooksBody
Y_10 = UnitY(Factor=expr("-x", eval_6))

# ---- group: FrictionPad
firstguideholerect = ListItem(List=rec_2pt.Rectangle, Index=0, Wrap=True)
guideextrusion_num_6 = Number(guideextrusion_num)
highfrictionpadthickness_num_3 = Number(highfrictionpadthickness_num)
Y_11 = UnitY(Factor=expr("-x", guideextrusion_num_6))
Y_12 = UnitY(Factor=expr("-x", highfrictionpadthickness_num_3))
move_11 = Move(Geometry=firstguideholerect, Motion=Y_11)  # -> Geometry, Transform
highfrictionpad_extr = Extrude(Base=move_11.Geometry, Direction=Y_12)

# ----
cap_5 = CapHoles(Brep=highfrictionpad_extr)

# ---- group: FrictionPad (continued)
mirror_2 = Mirror(Geometry=cap_5, Plane=bodyzaxisplane_pln_2)  # -> Geometry, Transform

# ----
highfrictionpadpreview = CustomPreview(Geometry=[mirror_2.Geometry, highfrictionpad_extr, cap_5], Material=flexiblematerial_col_3)

# ---- group: Hooks / HooksBody (continued)
move_12 = Move(Geometry=move_4.Geometry, Motion=Z_2)  # -> Geometry, Transform
move_13 = Move(Geometry=move_12.Geometry, Motion=Y_10)  # -> Geometry, Transform
move_14 = Move(Geometry=move_13.Geometry, Motion=Z_6)  # -> Geometry, Transform

move_15 = Move(Geometry=move_14.Geometry, Motion=expr("-x", Y_10))  # -> Geometry, Transform

move_16 = Move(Geometry=move_15.Geometry, Motion=Z_3)  # -> Geometry, Transform
move_17 = Move(Geometry=move_16.Geometry, Motion=Y_10)  # -> Geometry, Transform
pline_4 = PolyLine(
    Vertices=[move_3.Geometry, move_12.Geometry, move_13.Geometry, move_14.Geometry, move_16.Geometry, move_17.Geometry, move_2.Geometry, flip],
    Closed=False)
revsrf = Revolution(Curve=pline_4, Axis=pline_3, Domain=Domain(0, 6.283185307))
cap_6 = CapHoles(Brep=revsrf)
mirror_3 = Mirror(Geometry=cap_6, Plane=bodyxaxisplane)  # -> Geometry, Transform

# ----
previewhook = CustomPreview(Geometry=[cap_6, mirror_3.Geometry], Material=rigidmaterial_col_5)

# ---- group: Guides (continued)
flip_10 = FlipMatrix(Data=[flip_8, flip_6, flip_5, flip_4, flip_3, flip_2, flip_7, flip_9])
flip_11 = FlipMatrix(Data=flip_10)
flatten_4 = FlattenTree(Tree=arc_2.Arc, Path="{0}")
pline_5 = PolyLine(Vertices=flip_11, Closed=smaller.SmallerThan)
flatten_5 = FlattenTree(Tree=pline_5, Path="{0}")
join_3 = JoinCurves(Curves=[flatten_5, flatten_4], Preserve=True)

# ----
rdiff = RegionDifference(CurvesA=graft(pline_5), CurvesB=graft(guidecir))
boundary = BoundarySurfaces(Edges=rdiff)

# ---- group: Guides (continued)
extr_5 = Extrude(Base=[boundary, join_3], Direction=X)
cap_7 = CapHoles(Brep=extr_5)
mirror_4 = Mirror(Geometry=cap_7, Plane=bodyzaxisplane_pln_3)  # -> Geometry, Transform
sunion = SolidUnion(Breps=[mirror_4.Geometry, cap_7, extr_5])

# ----
previewguides = CustomPreview(Geometry=sunion, Material=rigidmaterial_col_4)
